# Grasshopper definition fez_grasshopper.gh (Grasshopper 1.0.8)
# plug-ins: RhinoCodePluginGH

nibmargin = Slider(0.4, range=0..1000000)
list = ValueList({"WhiteAndBlack": 1, "WhiteBlackRedBlue": 2, "RedBlue": 3}, selected="WhiteAndBlack")
lettersoverride = Panel("abcdef")
number_slider = Slider(220, range=0..300)
number_slider_2 = Slider(5, range=4..30)
number_slider_3 = Slider(0.3, range=0..5)
number_slider_4 = Slider(0.4, range=0..20)
number_slider_5 = Slider(2, range=0..20)
number_slider_6 = Slider(0.4, range=0..20)
number_slider_7 = Slider(190, range=0..300)
nibheight = Slider(5, range=0..1000000)
# On the far right are grouped blocks containing the generated model to be sliced (with Cura, etc) and lua code to be used with add_fez_gcode.lua in the github repo.
# 
# Detailed instructions exist in the repo, but as a reminder:
# 1. Bake, export, and slice the model.
# 2. Copy the generated lua code into the provided script.
# 3. Open the gcode file and get the last-used XYZ coords and assign them to startingPos in the lua script.
# 4. Modify the end of the gcode to prevent unwanted behavior, as detailed in the repo.
# 5. Run the lua script and insert it into the gcode file.
# 6. Print.
# This section controls the x,y features of the baseplates, the sizes of slots, tiles, and magnets, and adjustments for printer-specific settings. The unit of length is mm.
# 
# Printbed width should match the max size of your printable area. By default, the grid goes to a width of 19cm plus 1cm on each side for the interlock nibs, so a total space of 21x21cm is required. If your printbed is too small, reduce foundationMaxWidth and note the number of slots per baseplate, as you'll need to update settings in the website to match.
# 
# nozzleWidth should match the output diameter of your printer's nozzle.
# 
# It is recommended to not change tileGapFrac.
number_slider_8 = Slider(220, range=0..300)
number_slider_9 = Slider(0.4, range=0..5)
number_slider_10 = Slider(5, range=0..20)
number_slider_11 = Slider(2, range=0..20)
number_slider_12 = Slider(5, range=0..20)
# This section controls baseplate height and the interlock nibs.
# 
# You likely won't need to change anything here, though increasing nibMargin means you can be a bit less thorough when cleaning off supports.
foundationheight = Slider(10, range=0..100)
nibwidth = Slider(20, range=0..1000000)
nibdepth = Slider(10, range=0..1000000)
# This controls tile creation, with the parameters (hopefully) being self-explanatory.
# 
# If lettersOverride is blank, the full alphabet will be used.
# 
# The lua code generated will always print colors in order of white, black, (and if used) red, blue.
# 
# forceNumCols can be helpful for adjusting the resulting tile arrangement if certain areas of your buildplate aren't adhering as well. It will do nothing if set to 0.
number_slider_13 = Slider(2, range=1..10)
doredandblue = BooleanToggle(True)
# This section is for the physical translation key, a thin plate with Zuish and English letters.
# 
# For each symbol, there are two copies of the English letter, arranged so rotating the key will let you see the as-is translation or the rotated translation.
number_slider_14 = Slider(3, range=0..30)
py3_baseplate = Python3Script(
    printbedWidthX=number_slider_8,
    printbedWidthY=number_slider,
    nozzleWidth=number_slider_9,
    linesPerPixel=number_slider_2,
    tileGapFrac=number_slider_3,
    tileHeight=number_slider_10,
    slotHeight=number_slider_11,
    slotMargin=number_slider_4,
    magnetWidth=number_slider_12,
    magnetHeight=number_slider_5,
    magnetMargin=number_slider_6,
    foundationMaxWidth=number_slider_7,
    foundationHeight=foundationheight)  # -> out, luaCode, outputSrf, foundationWidth; inputs printbedWidthX: Double, printbedWidthY: Double, nozzleWidth: Double, linesPerPixel: Int32, tileGapFrac: Double, tileHeight: Double, slotHeight: Double, slotMargin: Double, magnetWidth: Double, magnetHeight: Double, magnetMargin: Double, foundationMaxWidth: Double, foundationHeight: Double
# ---------- py3_baseplate: Python ----------
import rhinoscriptsyntax as rs
import math

pixelWidth = nozzleWidth * linesPerPixel
shapeSize = 5
shapeSizeWithBorder = shapeSize + 2
tileWidth = shapeSizeWithBorder * pixelWidth
tileGap = tileWidth * tileGapFrac

numMarkers = math.floor(foundationMaxWidth / (tileWidth + tileGap))
numSlots = numMarkers - 2
foundationWidth = numMarkers * (tileWidth + tileGap)
luaCode = ""

if numSlots <= 0:
    raise("foundationMaxWidth is too small!")


def easyBox(center, sizeX, sizeY, sizeZ):
    radiusX = sizeX / 2
    radiusY = sizeY / 2
    radiusZ = sizeZ / 2

    return rs.AddBox([
        center + rs.CreateVector(-radiusX, radiusY, -radiusZ),
        center + rs.CreateVector(-radiusX, -radiusY, -radiusZ),
        center + rs.CreateVector(radiusX, -radiusY, -radiusZ),
        center + rs.CreateVector(radiusX, radiusY, -radiusZ),
        center + rs.CreateVector(-radiusX, radiusY, radiusZ),
        center + rs.CreateVector(-radiusX, -radiusY, radiusZ),
        center + rs.CreateVector(radiusX, -radiusY, radiusZ),
        center + rs.CreateVector(radiusX, radiusY, radiusZ),
    ])


outputSrf = easyBox(rs.CreatePoint(0, 0, foundationHeight / 2), foundationWidth, foundationWidth, foundationHeight)
print(tileGap)

tileStep = tileGap + tileWidth
tlcDist = foundationWidth / 2 - tileStep / 2
tlcMarker = rs.CreatePoint(-tlcDist, tlcDist, foundationHeight)
topLeftCenter = tlcMarker + rs.CreateVector(tileStep, -tileStep, -(slotHeight + slotMargin))

# Make the tile slots
slotSrfs = []
slotWidthTotal = tileWidth + slotMargin
slotHeightTotal = tileHeight + slotMargin

magnetHeightTotal = magnetHeight + magnetMargin

slotSrf = easyBox(rs.CreatePoint(0, 0, slotHeightTotal / 2), slotWidthTotal, slotWidthTotal, slotHeightTotal)
magnetHole = rs.AddCylinder((0, 0, -magnetHeightTotal), magnetHeightTotal + 1, (magnetWidth + magnetMargin) / 2, True)
slotSrf = rs.BooleanUnion([slotSrf, magnetHole])[0]

for i in range(0, numSlots):
    for i2 in range(0, numSlots):
        center = topLeftCenter + rs.CreateVector(tileStep * i, -tileStep * i2, 0)
        slotSrfs.append(rs.CopyObject(slotSrf, center))

for srf in slotSrfs:
    outputSrf = rs.BooleanDifference([outputSrf], [srf])[0]


# Generate lua for the 4 corner markers
luaZerosBlack = []

def luaVecStr(vec):
    return "Vector( " + str(vec.X) + ", " + str(vec.Y) + ", " + str(vec.Z) + " )"

luaCode = luaCode + "local originOffset = " + luaVecStr(rs.CreatePoint(printbedWidthX / 2, printbedWidthY / 2, 0)) + "\n"

def luaPosStr(vec):
    return "originOffset + " + luaVecStr(vec)

def luaDoCorner(corner, tileCenter, colorStrArr):
    global luaCode

    mainStr = "gcodePrintSymbol( shapes.corner" + corner + "[0], " + luaPosStr(tileCenter)
    luaCode = luaCode + mainStr + ", true )\n"
    colorStrArr.append(mainStr + ", false )\n")

def applyColorStrArr(colorStrArr):
    global luaCode

    for i, codeStr in enumerate(colorStrArr):
        luaCode = luaCode + codeStr
    colorStrArr.clear()


cornerDist = tileStep * (numMarkers - 1)
luaDoCorner("TL", tlcMarker, luaZerosBlack)
luaDoCorner("TR", tlcMarker + rs.CreateVector(cornerDist, 0, 0), luaZerosBlack)
luaDoCorner("BR", tlcMarker + rs.CreateVector(cornerDist, -cornerDist, 0), luaZerosBlack)
luaDoCorner("BL", tlcMarker + rs.CreateVector(0, -cornerDist, 0), luaZerosBlack)

luaCode = luaCode + "gcodeChangeFilament( 10 )\n"
applyColorStrArr(luaZerosBlack)

# Generate lua code for the user-friendly orientation indicator (orange plus)
plusCenter = tlcMarker + rs.CreateVector(cornerDist - tileStep, 0, 0)
luaCode = luaCode + "gcodeChangeFilament( 10 )\n"
luaCode = luaCode + "gcodePrintSymbol( shapes.plus[0], " + luaPosStr(plusCenter) + ", true )\n"
# ---------- end py3_baseplate ----------
py3_translation_key = Python3Script(
    printbedWidthX=number_slider_8,
    printbedWidthY=number_slider,
    nozzleWidth=number_slider_9,
    linesPerPixel=number_slider_2,
    tileGapFrac=number_slider_3,
    tileHeight=number_slider_10,
    slotHeight=number_slider_11,
    slotMargin=number_slider_4,
    magnetWidth=number_slider_12,
    magnetHeight=number_slider_5,
    magnetMargin=number_slider_6,
    foundationMaxWidth=number_slider_7,
    foundationHeight=foundationheight,
    plateHeight=number_slider_14,
    doRedAndBlue=doredandblue)  # -> out, luaCode, outputSrf, visSrfFez, visSrfsEnglishUpright, visSrfEUColoring, visSrfsEnglishSideways, visSrfESColoring; inputs printbedWidthX: Double, printbedWidthY: Double, nozzleWidth: Double, linesPerPixel: Int32, tileGapFrac: Double, tileHeight: Double, slotHeight: Double, slotMargin: Double, magnetWidth: Double, magnetHeight: Double, magnetMargin: Double, foundationMaxWidth: Double, foundationHeight: Double, doRedAndBlue: Boolean
# ---------- py3_translation_key: Python ----------
import rhinoscriptsyntax as rs
import math

pixelWidth = nozzleWidth * linesPerPixel
shapeSize = 5
shapeSizeWithBorder = shapeSize + 2
shapeWidth = shapeSize * pixelWidth
shapeWidthWithBorder = shapeSizeWithBorder * pixelWidth

luaCode = ""
luaCodeEnglishBlack = ""
luaCodeEnglishRed = ""
luaCodeEnglishBlue = ""
luaZerosBlack = []

visSrfEUColoring = []
visSrfESColoring = []


def easyBox(center, sizeX, sizeY, sizeZ):
    radiusX = sizeX / 2
    radiusY = sizeY / 2
    radiusZ = sizeZ / 2

    return rs.AddBox([
        center + rs.CreateVector(-radiusX, radiusY, -radiusZ),
        center + rs.CreateVector(-radiusX, -radiusY, -radiusZ),
        center + rs.CreateVector(radiusX, -radiusY, -radiusZ),
        center + rs.CreateVector(radiusX, radiusY, -radiusZ),
        center + rs.CreateVector(-radiusX, radiusY, radiusZ),
        center + rs.CreateVector(-radiusX, -radiusY, radiusZ),
        center + rs.CreateVector(radiusX, -radiusY, radiusZ),
        center + rs.CreateVector(radiusX, radiusY, radiusZ),
    ])



#sectionStep = shapeWidthWithBorder + shapeWidth * 1.5 + 1
sectionStep = shapeWidthWithBorder * 2 + 5
plateWidthX = 6 * sectionStep
plateWidthY = 4 * sectionStep
plate = easyBox(rs.CreatePoint(0, 0, plateHeight / 2), plateWidthX + 5, plateWidthY + 5, plateHeight)
outputSrf = plate


def luaVecStr(vec):
    return "Vector( " + str(vec.X) + ", " + str(vec.Y) + ", " + str(vec.Z) + " )"

luaCode = luaCode + "local originOffset = " + luaVecStr(rs.CreatePoint(printbedWidthX / 2, printbedWidthY / 2, 0)) + "\n"

def luaPosStr(vec):
    return "originOffset + " + luaVecStr(vec)

def luaDoLetter(letter, tileCenter, colorStrArr):
    global luaCode

    mainStr = "gcodePrintSymbol( letterToShape." + letter + ", " + luaPosStr(tileCenter)
    luaCode = luaCode + mainStr + ", true )\n"
    colorStrArr.append(mainStr + ", false )\n")

def luaDoEnglishLetter(letter, center, rotation):
    global luaCodeEnglishBlack
    global luaCodeEnglishRed
    global luaCodeEnglishBlue
    global visSrfEUColoring
    global visSrfESColoring

    mainStr = "gcodePrintSymbol( rotateShape( \"english" + letter + "\", " + str(rotation) + " ), " + luaPosStr(center)
    coloring = visSrfEUColoring if rotation == 0 else visSrfESColoring

    if doRedAndBlue and (letter == "K" or letter == "U"):
        luaCodeEnglishRed = luaCodeEnglishRed + mainStr + ", true )\n"
        coloring.append("255,0,0")
    elif doRedAndBlue and (letter == "Q" or letter == "V"):
        luaCodeEnglishBlue = luaCodeEnglishBlue + mainStr + ", true )\n"
        coloring.append("0,0,255")
    else:
        luaCodeEnglishBlack = luaCodeEnglishBlack + mainStr + ", true )\n"
        coloring.append("50,50,50")

def applyColorStrArr(colorStrArr):
    global luaCode

    for i, codeStr in enumerate(colorStrArr):
        luaCode = luaCode + codeStr
    colorStrArr.clear()



topLeftCorner = rs.CreatePoint(-(plateWidthX - shapeWidth) / 2, (plateWidthY - shapeWidth * 2) / 2, plateHeight)
letterGrid = [
    ["A", "B", "C", "D", "E", "F"],
    ["G", "H", "I", "J", "KQ", "L"],
    ["M", "N", "O", "P", "Z", "R"],
    ["S", "T", "UV", "W", "X", "Y"],
]



visSrfsFez = []
visSrfsEnglishUpright = []
visSrfsEnglishSideways = []

visSrfShape = easyBox(rs.CreatePoint(0, 0, 0.5), shapeWidth, shapeWidth, 1)
visSrfShapeWithBorder = easyBox(rs.CreatePoint(0, 0, 0.5), shapeWidthWithBorder, shapeWidthWithBorder, 1)

for r in range(0, 4):
    row = letterGrid[r]

    for c in range(0, 6):
        letters = row[c]
        sectionPos = topLeftCorner + rs.CreateVector(sectionStep * c, -sectionStep * r, 0)
        fezPos = sectionPos + rs.CreateVector(shapeWidth / 2 + shapeWidthWithBorder, 0, 0)

        luaDoLetter(letters[0], fezPos, luaZerosBlack)
        visSrfsFez.append(rs.CopyObject(visSrfShapeWithBorder, fezPos))

        for i, letter in enumerate(letters):
            #letterUprightPos = sectionPos + rs.CreateVector(shapeWidthWithBorder + shapeWidth * i, -shapeWidth, 0)
            #letterSidewaysPos = sectionPos + rs.CreateVector(shapeWidthWithBorder - shapeWidth, -shapeWidth * i, 0)
            uprightOffsetX = (shapeWidth / 2) if len(letters) == 1 else 0
            letterUprightPos = sectionPos + rs.CreateVector(shapeWidthWithBorder + shapeWidth * i + uprightOffsetX, -shapeWidthWithBorder, 0)
            letterSidewaysPos = sectionPos + rs.CreateVector(shapeWidthWithBorder - shapeWidth, -shapeWidth * i, 0)
            luaDoEnglishLetter(letter, letterUprightPos, 0)
            luaDoEnglishLetter(letter, letterSidewaysPos, 1)
            visSrfsEnglishUpright.append(rs.CopyObject(visSrfShape, letterUprightPos))
            visSrfsEnglishSideways.append(rs.CopyObject(visSrfShape, letterSidewaysPos))
        


luaCode = luaCode + "gcodeChangeFilament( 10 )\n"
applyColorStrArr(luaZerosBlack)
luaCode = luaCode + luaCodeEnglishBlack
luaCodeEnglishBlack = ""

if doRedAndBlue:
    luaCode = luaCode + "gcodeChangeFilament( 10 )\n"
    luaCode = luaCode + luaCodeEnglishRed
    luaCodeEnglishRed = ""

    luaCode = luaCode + "gcodeChangeFilament( 10 )\n"
    luaCode = luaCode + luaCodeEnglishBlue
    luaCodeEnglishBlue = ""


visSrfFez = rs.BooleanUnion(visSrfsFez)
#visSrfEnglishUpright = rs.BooleanUnion(visSrfsEnglishUpright)
#visSrfEnglishSideways = rs.BooleanUnion(visSrfsEnglishSideways)



'''
tileStep = tileGap + tileWidth
tlcDist = foundationWidth / 2 - tileStep / 2
tlcMarker = rs.CreatePoint(-tlcDist, tlcDist, foundationHeight)
#topLeftCenter = tlcMarker + rs.CreateVector(tileStep, -tileStep, tileHeight / 2 - slotHeight * 3)
topLeftCenter = tlcMarker + rs.CreateVector(tileStep, -tileStep, -(slotHeight + slotMargin))

# Make the tile slots
#slotBoxes = []
slotSrfs = []
slotWidthTotal = tileWidth + slotMargin
slotHeightTotal = tileHeight + slotMargin

magnetHeightTotal = magnetHeight + magnetMargin

slotSrf = easyBox(rs.CreatePoint(0, 0, slotHeightTotal / 2), slotWidthTotal, slotWidthTotal, slotHeightTotal)
magnetHole = rs.AddCylinder((0, 0, -magnetHeightTotal), magnetHeightTotal + 1, (magnetWidth + magnetMargin) / 2, True)
slotSrf = rs.BooleanUnion([slotSrf, magnetHole])[0]

for i in range(0, numSlots):
    for i2 in range(0, numSlots):
        center = topLeftCenter + rs.CreateVector(tileStep * i, -tileStep * i2, 0)
        #slotBoxes.append(easyBox(center, slotWidth, slotWidth, slotHeight))
        slotSrfs.append(rs.CopyObject(slotSrf, center))

#for srf in slotBoxes:
for srf in slotSrfs:
    outputSrf = rs.BooleanDifference([outputSrf], [srf])[0]

# Generate lua for the 4 corner markers
# TODO
printbedWidthX = 220
printbedWidthY = 220
luaZerosBlack = []

def luaVecStr(vec):
    return "Vector( " + str(vec.X) + ", " + str(vec.Y) + ", " + str(vec.Z) + " )"

luaCode = luaCode + "local originOffset = " + luaVecStr(rs.CreatePoint(printbedWidthX / 2, printbedWidthY / 2, 0)) + "\n"

def luaPosStr(vec):
    #return "startingPos + Vector( " + str(vec.X) + ", " + str(vec.Y) + ", " + str(vec.Z) + " )"
    return "originOffset + " + luaVecStr(vec)

def luaDoCorner(corner, tileCenter, colorStrArr):
    global luaCode

    mainStr = "gcodePrintSymbol( shapes.corner" + corner + "[0], " + luaPosStr(tileCenter)
    luaCode = luaCode + mainStr + ", true )\n"
    colorStrArr.append(mainStr + ", false )\n")

def applyColorStrArr(colorStrArr):
    global luaCode

    for i, codeStr in enumerate(colorStrArr):
        luaCode = luaCode + codeStr
    colorStrArr.clear()


cornerDist = tileStep * (numMarkers - 1)
luaDoCorner("TL", tlcMarker, luaZerosBlack)
luaDoCorner("TR", tlcMarker + rs.CreateVector(cornerDist, 0, 0), luaZerosBlack)
luaDoCorner("BR", tlcMarker + rs.CreateVector(cornerDist, -cornerDist, 0), luaZerosBlack)
luaDoCorner("BL", tlcMarker + rs.CreateVector(0, -cornerDist, 0), luaZerosBlack)

luaCode = luaCode + "gcodeChangeFilament( 10 )\n"
applyColorStrArr(luaZerosBlack)

plusCenter = tlcMarker + rs.CreateVector(cornerDist - tileStep, 0, 0)
luaCode = luaCode + "gcodeChangeFilament( 10 )\n"
luaCode = luaCode + "gcodePrintSymbol( shapes.plus[0], " + luaPosStr(plusCenter) + ", true )\n"
'''
# ---------- end py3_translation_key ----------
py3_tiles = Python3Script(
    printbedWidthX=number_slider_8,
    printbedWidthY=number_slider,
    nozzleWidth=number_slider_9,
    linesPerPixel=number_slider_2,
    tileGapFrac=number_slider_3,
    tileHeight=number_slider_10,
    slotHeight=number_slider_11,
    slotMargin=number_slider_4,
    magnetWidth=number_slider_12,
    magnetHeight=number_slider_5,
    magnetMargin=number_slider_6,
    foundationMaxWidth=number_slider_7,
    foundationHeight=foundationheight,
    letterCopies=number_slider_13,
    colorMode=list,
    lettersOverride=lettersoverride,
    forceNumCols=Slider(6, range=0..30))  # -> out, luaCode, outputSrf; inputs printbedWidthX: Double, printbedWidthY: Double, nozzleWidth: Double, linesPerPixel: Int32, tileGapFrac: Double, tileHeight: Double, slotHeight: Double, slotMargin: Double, magnetWidth: Double, magnetHeight: Double, magnetMargin: Double, foundationMaxWidth: Double, foundationHeight: Double, letterCopies: Int32, colorMode: Int32, lettersOverride: String, forceNumCols: Int32
# ---------- py3_tiles: Python ----------
import rhinoscriptsyntax as rs
import math

pixelWidth = nozzleWidth * linesPerPixel
shapeSize = 5
shapeSizeWithBorder = shapeSize + 2
tileWidth = shapeSizeWithBorder * pixelWidth
tileGap = tileWidth * tileGapFrac

numMarkers = math.floor(foundationMaxWidth / (tileWidth + tileGap))
numSlots = numMarkers - 2
foundationWidth = numMarkers * (tileWidth + tileGap)
luaCode = ""

if numSlots <= 0:
    raise("foundationMaxWidth is too small!")

print(tileWidth)
print(pixelWidth)

def easyBox(center, sizeX, sizeY, sizeZ):
    radiusX = sizeX / 2
    radiusY = sizeY / 2
    radiusZ = sizeZ / 2

    return rs.AddBox([
        center + rs.CreateVector(-radiusX, radiusY, -radiusZ),
        center + rs.CreateVector(-radiusX, -radiusY, -radiusZ),
        center + rs.CreateVector(radiusX, -radiusY, -radiusZ),
        center + rs.CreateVector(radiusX, radiusY, -radiusZ),
        center + rs.CreateVector(-radiusX, radiusY, radiusZ),
        center + rs.CreateVector(-radiusX, -radiusY, radiusZ),
        center + rs.CreateVector(radiusX, -radiusY, radiusZ),
        center + rs.CreateVector(radiusX, radiusY, radiusZ),
    ])

tileStep = tileGap + tileWidth


def luaVecStr(vec):
    return "Vector( " + str(vec.X) + ", " + str(vec.Y) + ", " + str(vec.Z) + " )"

luaCode = luaCode + "local originOffset = " + luaVecStr(rs.CreatePoint(printbedWidthX / 2, printbedWidthY / 2, 0)) + "\n"

def luaPosStr(vec):
    return "originOffset + " + luaVecStr(vec)


tiles = []
tileTopOffset = rs.CreatePoint(0, 0, tileHeight)
luaZerosBlack = []
luaOnesRed = []
luaOnesBlue = []

tile = easyBox(rs.CreatePoint(0, 0, tileHeight / 2), tileWidth, tileWidth, tileHeight)
magnetHole = rs.AddCylinder((0, 0, 0), magnetHeight + magnetMargin, (magnetWidth + magnetMargin) / 2, True)
tile = rs.BooleanDifference([tile], [magnetHole])[0]


def luaGetLetter(letter, tileCenter, doOnes):
    doOnesStr = "true" if doOnes else "false"
    return "gcodePrintSymbol( letterToShape." + letter + ", " + luaPosStr(tileCenter + tileTopOffset) + ", " + doOnesStr + " )\n"

def luaDoLetter(letter, tileCenter, colorStrArr):
    global luaCode

    '''
    mainStr = "gcodePrintSymbol( letterToShape." + letter + ", " + luaPosStr(tileCenter + tileTopOffset)
    luaCode = luaCode + mainStr + ", true )\n"
    colorStrArr.append(mainStr + ", " + colorStrArrOption + " )\n")
    '''

    luaCode = luaCode + luaGetLetter(letter, tileCenter, True)
    colorStrArr.append(luaGetLetter(letter, tileCenter, False))

def applyColorStrArr(colorStrArr):
    global luaCode

    for i, codeStr in enumerate(colorStrArr):
        luaCode = luaCode + codeStr
    colorStrArr.clear()


letters = "ABCDEFGHIJKLMNOPQRSTUVWXYZ"

if colorMode == 3:
    letters = "KQUV"

if lettersOverride != "":
    letters = lettersOverride.upper()

lettersNew = ""

for letter in letters:
    for i in range(0, letterCopies):
        lettersNew = lettersNew + letter

letters = lettersNew
numTiles = len(letters)

numCols = math.floor(math.sqrt(numTiles))
if forceNumCols != 0:
    numCols = forceNumCols
numRows = math.ceil(numTiles / numCols)



tileStep = tileWidth + tileGap
tlcDist = (tileStep * (numRows - 1)) / 2
topLeftCenter = rs.CreatePoint(
    -(tileStep * (numCols - 1)) / 2, 
    (tileStep * (numRows - 1)) / 2, 
    0
)

r = 0
c = 0

for letter in letters:
    tileCenter = topLeftCenter + rs.CreateVector(c * tileStep, -r * tileStep, 0)
    tiles.append(rs.CopyObject(tile, tileCenter))

    if colorMode == 1:
        luaDoLetter(letter, tileCenter, luaZerosBlack)
    elif letter == "K" or letter == "U":
        #luaDoLetter(letter, tileCenter, luaOnesRed, "true")
        luaOnesRed.append(luaGetLetter(letter, tileCenter, True))
        luaZerosBlack.append(luaGetLetter(letter, tileCenter, False))
    elif letter == "Q" or letter == "V":
        #luaDoLetter(letter, tileCenter, luaOnesBlue, "true")
        luaOnesBlue.append(luaGetLetter(letter, tileCenter, True))
        luaZerosBlack.append(luaGetLetter(letter, tileCenter, False))
    else:
        luaDoLetter(letter, tileCenter, luaZerosBlack)
    
    c = c + 1

    if c == numCols:
        c = 0
        r = r + 1


luaCode = luaCode + "gcodeChangeFilament( 10 )\n"
applyColorStrArr(luaZerosBlack)

if colorMode == 2 or colorMode == 3:
    luaCode = luaCode + "gcodeChangeFilament( 10 )\n"
    applyColorStrArr(luaOnesRed)

    luaCode = luaCode + "gcodeChangeFilament( 10 )\n"
    applyColorStrArr(luaOnesBlue)


#outputSrf = rs.JoinSurfaces(tiles)
outputSrf = tiles
# ---------- end py3_tiles ----------
py3_add_interlocks = Python3Script(
    inputSrf=py3_baseplate.outputSrf,
    width=py3_baseplate.foundationWidth,
    foundationHeight=foundationheight,
    nibWidth=nibwidth,
    nibDepth=nibdepth,
    nibHeight=nibheight,
    nibMargin=nibmargin)  # -> out, a; inputs width: Double, foundationHeight: Double, nibWidth: Double, nibDepth: Double, nibHeight: Double, nibMargin: Double
# ---------- py3_add_interlocks: Python ----------
import rhinoscriptsyntax as rs

heightMarkerSize = 1
nibRaise = (foundationHeight - nibHeight) / 2
srfsToUnion = []
srfsToDifference = []

nibOut = rs.AddBox([
    rs.CreatePoint(-(nibWidth - nibMargin) / 2, nibDepth - nibMargin, nibMargin / 2 + nibRaise),
    rs.CreatePoint(-(nibWidth - nibMargin) / 2, -1, nibMargin / 2 + nibRaise),
    rs.CreatePoint((nibWidth - nibMargin) / 2, -1, nibMargin / 2 + nibRaise),
    rs.CreatePoint((nibWidth - nibMargin) / 2, nibDepth - nibMargin, nibMargin / 2 + nibRaise),
    rs.CreatePoint(-(nibWidth - nibMargin) / 2, nibDepth - nibMargin, nibHeight - nibMargin / 2 + nibRaise),
    rs.CreatePoint(-(nibWidth - nibMargin) / 2, -1, nibHeight - nibMargin / 2 + nibRaise),
    rs.CreatePoint((nibWidth - nibMargin) / 2, -1, nibHeight - nibMargin / 2 + nibRaise),
    rs.CreatePoint((nibWidth - nibMargin) / 2, nibDepth - nibMargin, nibHeight - nibMargin / 2 + nibRaise),
])

nibIn = rs.AddBox([
    rs.CreatePoint(-nibWidth / 2, 1, nibRaise),
    rs.CreatePoint(-nibWidth / 2, -nibDepth, nibRaise),
    rs.CreatePoint(nibWidth / 2, -nibDepth, nibRaise),
    rs.CreatePoint(nibWidth / 2, 1, nibRaise),
    rs.CreatePoint(-nibWidth / 2, 1, nibHeight + nibRaise),
    rs.CreatePoint(-nibWidth / 2, -nibDepth, nibHeight + nibRaise),
    rs.CreatePoint(nibWidth / 2, -nibDepth, nibHeight + nibRaise),
    #rs.CreatePoint(nibWidth / 2, 0, nibHeight + nibRaise),
    rs.CreatePoint(nibWidth / 2, 1, nibHeight + nibRaise),
])


vec0 = rs.CreatePoint(0, 0, 0)
vecUp = rs.CreatePoint(0, 0, 1)


# North
trnsVec = rs.CreatePoint(0, width / 2, 0)
srfsToUnion.append(rs.CopyObject(nibOut, trnsVec))

trnsVec = rs.CreatePoint(-nibWidth * 1.5, width / 2, 0)
srfsToDifference.append(rs.CopyObject(nibIn, trnsVec))

trnsVec = rs.CreatePoint(nibWidth * 1.5, width / 2, 0)
srfsToDifference.append(rs.CopyObject(nibIn, trnsVec))


# South
trnsRot = 180
nibOutTemp = rs.RotateObject(nibOut, vec0, trnsRot, vecUp, True)
nibInTemp = rs.RotateObject(nibIn, vec0, trnsRot, vecUp, True)

trnsVec = rs.CreatePoint(-nibWidth * 1.5, -width / 2, 0)
srfsToUnion.append(rs.CopyObject(nibOutTemp, trnsVec))

trnsVec = rs.CreatePoint(nibWidth * 1.5, -width / 2, 0)
srfsToUnion.append(rs.CopyObject(nibOutTemp, trnsVec))

trnsVec = rs.CreatePoint(0, -width / 2, 0)
srfsToDifference.append(rs.CopyObject(nibInTemp, trnsVec))


# East
trnsRot = 270
nibOutTemp = rs.RotateObject(nibOut, vec0, trnsRot, vecUp, True)
nibInTemp = rs.RotateObject(nibIn, vec0, trnsRot, vecUp, True)

trnsVec = rs.CreatePoint(width / 2, 0, 0)
srfsToUnion.append(rs.CopyObject(nibOutTemp, trnsVec))

trnsVec = rs.CreatePoint(width / 2, -nibWidth * 1.5, 0)
srfsToDifference.append(rs.CopyObject(nibInTemp, trnsVec))

trnsVec = rs.CreatePoint(width / 2, nibWidth * 1.5, 0)
srfsToDifference.append(rs.CopyObject(nibInTemp, trnsVec))


# West
trnsRot = 90
nibOutTemp = rs.RotateObject(nibOut, vec0, trnsRot, vecUp, True)
nibInTemp = rs.RotateObject(nibIn, vec0, trnsRot, vecUp, True)

trnsVec = rs.CreatePoint(-width / 2, -nibWidth * 1.5, 0)
srfsToUnion.append(rs.CopyObject(nibOutTemp, trnsVec))

trnsVec = rs.CreatePoint(-width / 2, nibWidth * 1.5, 0)
srfsToUnion.append(rs.CopyObject(nibOutTemp, trnsVec))

trnsVec = rs.CreatePoint(-width / 2, 0, 0)
srfsToDifference.append(rs.CopyObject(nibInTemp, trnsVec))



outputSrf = inputSrf

for srf in srfsToUnion:
    outputSrf = rs.BooleanUnion([outputSrf, srf])[0]

for srf in srfsToDifference:
    outputSrf = rs.BooleanDifference([outputSrf], [srf])[0]


a = outputSrf
# ---------- end py3_add_interlocks ----------

baseplate_lua_code = Panel(py3_baseplate.luaCode)
brep_baseplate_model = Brep(py3_add_interlocks.a)

tile_lua_code = Panel(py3_tiles.luaCode)
brep_tiles = Brep(py3_tiles.outputSrf)

preview = CustomPreview(Geometry=py3_translation_key.visSrfsEnglishSideways, Material=py3_translation_key.visSrfESColoring)
preview_2 = CustomPreview(Geometry=py3_translation_key.visSrfsEnglishUpright, Material=py3_translation_key.visSrfEUColoring)
brep = Brep(py3_translation_key.visSrfFez)

translation_key_lua_code = Panel(py3_translation_key.luaCode)
brep_translation_key = Brep(py3_translation_key.outputSrf)
